# Dynamo graph IR_Analysis.dyn (Dynamo 3.4.1.0)
# Infrared analysis for Revit 2026: ground, facades or both. Open Dynamo, press Run.

# note: IR_Analysis: one script for ground, facades or both.
# target: ground | facades | both (also all). "both" = two runs, two costs.
# analysis labels, ground: svf, solar, sun-hours, wind, utci, pwc, tcs
# pwc and tcs take a criterion or subtype as the last word: "pwc lawson-2001", "tcs heat-stress"
# analysis labels, facades: svf, solar, sun-hours, daylight
# both: wind, utci, pwc and tcs run on ground only, daylight on facades only; the other target is skipped.
# show-last: draw the saved results again, free (no run).
# Keep preview_only True first: it shows the cost for free.

# group: Folder where you unzipped the libs zip. %APPDATA% is allowed.
libs_folder = StringInput("%APPDATA%\Infrared\revit-dynamo")  # graph input

# group: Select Model Elements: the buildings to analyse.
select_model_elements = DSModelElementsSelection()  # nothing selected

# group: ground, facades or both (both = two runs, two costs). Also: all.
target = StringInput("both")  # graph input

# group: One label. ground: svf, solar, sun-hours, daylight, wind, pwc, tcs, utci. facades: svf, solar, sun-hours, daylight. both: runs where it exists. show-last: draw the saved results again (free).
analysis = StringInput("svf")  # graph input

# group: Months, for example 6-8 or 1,2,12. Used by solar, sun-hours, daylight, utci.
months = StringInput("6-8")  # graph input

# group: Hours of the day, for example 8-18.
hours = StringInput("8-18")  # graph input

# group: True: free preview of the cost. False: run and pay tokens.
preview_only = BoolSelector(true)  # graph input

# group: True: add public buildings around the selection.
fetch_context = BoolSelector(false)  # graph input

# group: Latitude in degrees. Empty: use the Revit project location.
lat = StringInput("")  # graph input

# group: Longitude in degrees. Empty: use the Revit project location.
lon = StringInput("")  # graph input

# group: Wind only: speed in m/s.
wind_speed = DoubleInput(5)  # graph input

# group: Wind only: bearing in degrees the wind comes from (270 = west).
wind_direction = DoubleInput(270)  # graph input

# group: Facade part only: facades, roofs or all.
surfaces = StringInput("all")  # graph input

# group: True: open the API key dialog and stop.
set_api_key = BoolSelector(false)  # graph input

legend = StringInput("platform")  # graph input
gradient = BoolSelector(false)  # graph input

# group: command: one line runs everything; type help for the words. Examples: pwc | wind 5 270 run | utci facades months 6-8 | show-last legend exact. Without run: free preview. Empty: the nodes below are used.
command = StringInput("")  # graph input

python_script_analysis = Python(IN[0]=libs_folder, IN[1]=select_model_elements, IN[2]=target, IN[3]=analysis, IN[4]=months, IN[5]=hours, IN[6]=preview_only, IN[7]=fetch_context, IN[8]=lat, IN[9]=lon, IN[10]=wind_speed, IN[11]=wind_direction, IN[12]=surfaces, IN[13]=set_api_key, IN[14]=legend, IN[15]=gradient, IN[16]=command)  # CPython3
# ---------- python_script_analysis.python (19 lines) ----------
# Infrared analysis (ground, facades or both). No logic here: all of it is in the libs folder.
import os, sys, traceback
try:
    libs = os.path.expandvars(IN[0])
    if libs not in sys.path:
        sys.path.insert(0, libs)
    # Forget the loaded ir_* modules: the next import reads every edited file again.
    # (importlib.reload one by one can leave an old module in place.)
    for name in [m for m in sys.modules if m.split('.')[0] in ('ir_dynamo', 'ir_revit')]:
        del sys.modules[name]
    from ir_revit.entry import run
    OUT = run(target=IN[2], elements=IN[1], analysis=IN[3], months=IN[4], hours=IN[5], preview_only=IN[6], fetch_context=IN[7], lat=IN[8], lon=IN[9], wind_speed=IN[10], wind_direction=IN[11], surfaces=IN[12], set_api_key=IN[13], legend=IN[14], gradient=IN[15], command=IN[16])
except Exception:
    OUT = ['Script error (also in ~/.infrared/revit-dynamo-runs.log):'] + traceback.format_exc().splitlines()
    try:
        with open(os.path.join(os.path.expanduser('~'), '.infrared', 'revit-dynamo-runs.log'), 'a') as log:
            log.write('=== script error\n' + traceback.format_exc() + '\n')
    except Exception:
        pass
# ----------------------------------------
watch = Watch(python_script_analysis)
