# Dynamo graph IR_Ground.dyn (Dynamo 3.4.1.0)
# Infrared ground analysis for Revit 2026. Open Dynamo, press Run.

# group: Folder where you unzipped the libs zip. %APPDATA% is allowed.
libs_folder = StringInput("%APPDATA%\Infrared\revit-dynamo")  # graph input

# group: Select Model Elements: the buildings to analyse.
select_model_elements = DSModelElementsSelection()  # nothing selected

# group: One of: svf, solar, sun-hours, wind, utci
analysis = StringInput("svf")  # graph input

# group: Months, for example 6-8 or 1,2,12. Used by solar, sun-hours, daylight, utci.
months = StringInput("6-8")  # graph input

# group: Hours of the day, for example 8-18.
hours = StringInput("8-18")  # graph input

# group: True: free preview of the cost. False: run and pay tokens.
preview_only = BoolSelector(true)  # graph input

# group: True: add public buildings around the selection.
fetch_context = BoolSelector(false)  # graph input

# group: Latitude in degrees. Empty: use the Revit project location.
lat = StringInput("")  # graph input

# group: Longitude in degrees. Empty: use the Revit project location.
lon = StringInput("")  # graph input

# group: Wind only: speed in m/s.
wind_speed = DoubleInput(5)  # graph input

# group: Wind only: bearing in degrees the wind comes from (270 = west).
wind_direction = DoubleInput(270)  # graph input

# group: True: open the API key dialog and stop.
set_api_key = BoolSelector(false)  # graph input

python_script_ground = Python(IN[0]=libs_folder, IN[1]=select_model_elements, IN[2]=analysis, IN[3]=months, IN[4]=hours, IN[5]=preview_only, IN[6]=fetch_context, IN[7]=lat, IN[8]=lon, IN[9]=wind_speed, IN[10]=wind_direction, IN[11]=set_api_key)  # CPython3
# ---------- python_script_ground.python (9 lines) ----------
# Infrared Ground. No logic here: all of it is in the libs folder.
import os, sys, importlib
libs = os.path.expandvars(IN[0])
if libs not in sys.path:
    sys.path.insert(0, libs)
for name in ('ir_dynamo.settings', 'ir_dynamo.frame', 'ir_dynamo.terrain', 'ir_dynamo.meshes', 'ir_dynamo.payloads', 'ir_dynamo.results', 'ir_dynamo.env', 'ir_dynamo.run', 'ir_revit.revit_location', 'ir_revit.revit_geometry', 'ir_revit.result_mesh', 'ir_revit.revit_display', 'ir_revit.revit_apikey', 'ir_revit.entry'):
    importlib.reload(importlib.import_module(name))  # picks up edited files
from ir_revit.entry import run
OUT = run('ground', IN[1], IN[2], IN[3], IN[4], IN[5], IN[6], IN[7], IN[8], set_api_key=IN[11], wind_speed=IN[9], wind_direction=IN[10])
# ----------------------------------------
watch = Watch(python_script_ground)
